# Grasshopper definition 200529_pyembroideryGH_Example_01.gh (Grasshopper 1.0.7)
# Copyright: 2018
# Copyright: 2019

# ----
# Geometry Pipeline
# reading geometry from a Rhino Layer
embroidery_curves = GeometryPipeline(
    GroupByLayer=False,
    GroupByType=False,
    IncludeHidden=True,
    IncludeLocked=True,
    LayerFilter="ref___EmbroideryCurves",
    NameFilter="*",
    SublayerFiltering=True,
    TypeFilter=4)
pipeline__embroiderycurves = Curve(embroidery_curves)

# ----
# Hier wird die Kurve referenziert oder eingespeist,
# die in Stiche umgewandelt werden soll >>>
# Die Resolution (Auflösung) legt fest, wie
# oft die Kurve geteilt wird (Feinheitsgrad) >>>
# Mit Width (Breite) wird bei
# Satinstichen die Breite (in mm) angegeben >>>
open_embroiderycurves_stitchresolution = Slider(755, range=0..2000)
open_embroiderycurves_stitchwidth = Slider(1, range=0..50)
pipeline__embroiderycurves_2 = Curve(pipeline__embroiderycurves)

# ----
# Verschiedene Stiche
# zum ausprobieren
winkelsatinstich = WinkelSatinstich(input_crv=<geometry referenced from the Rhino model>)
geradstich = Geradstich(input_crv=<geometry referenced from the Rhino model>)
satinstichgleichmaessig = SatinstichGleichmaessig(input_crv=<geometry referenced from the Rhino model>)
satinstich = Satinstich(input_crv=<geometry referenced from the Rhino model>)
vorzurueckstich = VorZurueckStich(input_crv=<geometry referenced from the Rhino model>)

# ----
# Stichpunkte aus Kurve erstellen
satinstichgleichmaessig_2 = SatinstichGleichmaessig(
    input_crv=pipeline__embroiderycurves_2,
    division_count=open_embroiderycurves_stitchresolution,
    width=open_embroiderycurves_stitchwidth)
stitch_points = Point(satinstichgleichmaessig_2)

# ----
# create a coloured thread
# for the embroidery pattern
colour = ColourPicker(PickedColour=RGB(0, 255, 234))
ct = ConstructThread(ColorRGB=colour)  # -> Thread; inputs ColorRGB: tree of Color, Description: tree, CatalogNr: tree, Details: tree, Brand: tree, Chart: tree, Weight: tree
# ---------- ct: Python ----------
"""Constructs an embroidery thread from its component parts. The thread is
returned as an instance of pyembroidery.EmbThread.
            Inputs:
                ColorRGB: The color of the thread as RGB color (required)
                Description: The color description of the thread (optional)
                CatalogNr: The catalogue number of the thread (optional)
                Details: The details of the thread (optional)
                Brand: The brand of the thread (optional)
                Chart: The chart of the thread (optional)
                Weight: The weight of the thread (optional)
            Output:
                Thread: The newly constructed thread for a stitch/pattern as
                        pyembroidery.EmbThread instance
            Remarks:
                Author: Max Eschenbach
                License: Apache License 2.0
                Version: 191104"""

from __future__ import division
from ghpythonlib.componentbase import executingcomponent as component
import Grasshopper, GhPython
import System
import Rhino
import rhinoscriptsyntax as rs
import pyembroidery
import System.Drawing.Color as SysColor

ghenv.Component.Name = "ConstructThread"
ghenv.Component.NickName = "CT"
ghenv.Component.Category = "pyembroideryGH"
ghenv.Component.SubCategory = "3 Pattern Creation"

__author__ = "Max Eschenbach"
__version__ = "2019.11.04"

class ConThread(component):

    def RunScript(self, ColorRGB, Description, CatalogNr, Details, Brand,
                                                                Chart, Weight):
        # initialize output as empty GH datatree
        Thread = Grasshopper.DataTree[object]()
        
        # abort if no color input is supplied
        if (ColorRGB == None or \
        isinstance(ColorRGB, Grasshopper.DataTree[object]) != True):
            return Thread
        
        # loop through all branches
        for i in range(ColorRGB.BranchCount):
            branchList = ColorRGB.Branch(i)
            branchPath = ColorRGB.Path(i)
            
            # loop through all items in current branch
            for j in range(branchList.Count):
                # create new thread
                thrd = pyembroidery.EmbThread()
                
                # set the color of the newly created thread
                col = branchList[j]
                thrd.set_color(col.R, col.G, col.B)
                
                # look for corresponding data in the other inputs by looking
                # for the exact same path as the ColorRGB-Input
                # COMBINATIONS FOR DESCRIPTION
                if Description.PathExists(branchPath):
                    try:
                        cList = list(Description.Branch(branchPath))
                        thrd.description = cList[j]
                    except IndexError:
                        thrd.description = None
                # COMBINATIONS FOR CATALOG NUMBER
                if CatalogNr.PathExists(branchPath):
                    try:
                        cList = list(CatalogNr.Branch(branchPath))
                        thrd.catalog_number = cList[j]
                    except IndexError:
                        thrd.catalog_number = None
                # COMBINATIONS FOR DETAILS
                if Details.PathExists(branchPath):
                    try:
                        cList = list(Details.Branch(branchPath))
                        thrd.details = cList[j]
                    except IndexError:
                        thrd.details = None
                # COMBINATIONS FOR BRAND
                if Brand.PathExists(branchPath):
                    try:
                        cList = list(Brand.Branch(branchPath))
                        thrd.brand = cList[j]
                    except IndexError:
                        thrd.brand = None
                # COMBINATIONS FOR CHART
                if Chart.PathExists(branchPath):
                    try:
                        cList = list(Chart.Branch(branchPath))
                        thrd.chart = cList[j]
                    except IndexError:
                        thrd.chart = None
                # COMBINATIONS FOR WEIGHT
                if Weight.PathExists(branchPath):
                    try:
                        cList = list(Weight.Branch(branchPath))
                        thrd.weight = cList[j]
                    except IndexError:
                        thrd.weight = None

                # add the thread to the output tree
                Thread.Add(thrd, branchPath)

        # return outputs if you have them; here I try it for you:
        return Thread
# ---------- end ct ----------

# ----
# preview the stitchpoints with the colour
# of the thread
stitch_points_2 = Point(stitch_points)
pline = PolyLine(Vertices=stitch_points_2, Closed=False)
preview = CustomPreview(Geometry=pline, Material=colour)

# ----
# assign a command to every stich
# point
# 
# STITCH is the standard command
# telling the machine to make a stitch
# at this coordinate
panel = Panel("STITCH")
stitch_points_3 = Point(stitch_points)
stc = StringToCommand(CmdStr=panel)  # -> Cmd; inputs CmdStr: tree
# ---------- stc: Python ----------
"""Converts any embroidery command from its String-form into
its Integer representation.
            Inputs:
                CmdStr: The embroidery command as String
            Output:
                Cmd: The converted embroidery command as Integer
            Remarks:
                Author: Max Eschenbach
                License: Apache License 2.0
                Version: 191104"""

from __future__ import division
from ghpythonlib.componentbase import executingcomponent as component
import Grasshopper, GhPython
import System
import Rhino
import rhinoscriptsyntax as rs
import pyembroidery

ghenv.Component.Name = "StringToCommand"
ghenv.Component.NickName = "STC"
ghenv.Component.Category = "pyembroideryGH"
ghenv.Component.SubCategory = "0 Commands"

__author__ = "Max Eschenbach"
__version__ = "2019.11.04"

class StrToCmd(component):

    def RunScript(self, CmdStr):
        # initialize output
        Cmd = None
        # retrieve command dictionary for translation
        command_dict = pyembroidery.get_command_dictionary()
        # only do sth if there is valid input to begin with
        if (CmdStr != None and \
        isinstance(CmdStr, Grasshopper.DataTree[object]) == True):
            # initialize output as GH tree
            Cmd = Grasshopper.DataTree[object]()
            # loop through all branches of the tree
            for i in range(CmdStr.BranchCount):
                branchList = CmdStr.Branch(i)
                branchPath = CmdStr.Path(i)
                # loop through all items in the current branch
                for j in range(branchList.Count):
                    # look up the command in the dict and add the result to
                    # the output tree
                    Cmd.Add(command_dict.get(branchList[j]), branchPath)

        # return outputs if you have them; here I try it for you:
        return Cmd
# ---------- end stc ----------
lng = ListLength(List=stitch_points_3)
dup = DuplicateData(Data=stc, Number=lng, Order=True)  # -> simplify(flatten(Data))
cs = ConstructStitch(Pt=stitch_points_3, Cmd=dup)  # -> Stitch; inputs Pt: tree of Point3d, Cmd: tree of Int32
# ---------- cs: Python ----------
"""Constructs a Stitch-String in the format "PtX,PtY,Cmd"
            Inputs:
                Pt: The input Point(s)
                Cmd: The corresponding Command for each point coordinate
            Output:
                Stitch: The data for the stitch as String
            Remarks:
                Author: Max Eschenbach
                License: Apache License 2.0
                Version: 191104"""

from __future__ import division
from ghpythonlib.componentbase import executingcomponent as component
import Grasshopper, GhPython
import System
import Rhino
import rhinoscriptsyntax as rs
import pyembroidery

ghenv.Component.Name = "ConstructStitch"
ghenv.Component.NickName = "CS"
ghenv.Component.Category = "pyembroideryGH"
ghenv.Component.SubCategory = "3 Pattern Creation"

__author__ = "Max Eschenbach"
__version__ = "2019.11.04"

class MyComponent(component):

    def RunScript(self, Pt, Cmd):
        # initialize ouputs
        Stitch = None

        # only do something if there is data to begin with
        if (Pt != None and Cmd != None and \
        isinstance(Pt, Grasshopper.DataTree[object]) == True and \
        isinstance(Cmd, Grasshopper.DataTree[object]) == True):
            # case: both inputs as trees with more than one path
            if Pt.BranchCount > 1 and Cmd.BranchCount > 1:
                # subcase: both BranchCount and number of items are identical
                pt_ipb = [len(br) for br in Pt.Branches]
                cmd_ipb = [len(br) for br in Cmd.Branches]
                if pt_ipb == cmd_ipb:
                    Stitch = Grasshopper.DataTree[object]()
                    for i in range(Pt.BranchCount):
                        branchList = Pt.Branch(i)
                        branchPath = Pt.Path(i)
                        for j in range(branchList.Count):
                            pt = list(branchList[j])
                            comm = Cmd.Branch(i)[j]
                            stitch_str = (",".join([str(pt[0]*10),
                                            str(pt[1]*10), str(comm)]))
                            Stitch.Add(stitch_str, branchPath)
                # subcase: branchcount and number of items are not identical
                elif pt_ipb != cmd_ipb:
                    # sub-subcase: only branchcount is identical
                    if (Pt.BranchCount == Cmd.BranchCount and \
                    cmd_ipb == [1 for b in Cmd.Branches]):
                        Stitch = Grasshopper.DataTree[object]()
                        for i in range(Pt.BranchCount):
                            branchList = Pt.Branch(i)
                            branchPath = Pt.Path(i)
                            for j in range(branchList.Count):
                                pt = list(branchList[j])
                                comm = Cmd.Branch(i)[0]
                                stitch_str = (",".join([str(pt[0]*10),
                                                str(pt[1]*10), str(comm)]))
                                Stitch.Add(stitch_str, branchPath)
                    # both branchcount and items per branch differ completely
                    else:
                        raise NotImplementedError("Combining a tree of " + \
                            "points with a tree of commands that is " + \
                            "fundamentally different in structure " + \
                            "is not implemented yet! Still thinking of a " + \
                            "useful way to handle this...")
            # case: tree of points and flat list or single item
            elif Pt.BranchCount > 1 and Cmd.BranchCount == 1:
                # subcase: cmd is a flat list
                # behaviour: thinking of something useful...
                if Cmd.Branch(0).Count > 1:
                    raise NotImplementedError("The combination of a tree " + \
                            "of points and flat list of commands has not " + \
                            "been implemented yet! Still thinking of a " + \
                            "useful way to handle this...")
                # subcase: cmd is one single item
                # behaviour: cmd is applied to the whole tree of stitch-points
                elif Cmd.Branch(0).Count == 1:
                    Stitch = Grasshopper.DataTree[object]()
                    for i in range(Pt.BranchCount):
                        branchList = Pt.Branch(i)
                        branchPath = Pt.Path(i)
                        for j in range(branchList.Count):
                            pt = list(branchList[j])
                            comm = Cmd.Branch(0)[0]
                            stitch_str = (",".join([str(pt[0]*10),
                                              str(pt[1]*10), str(comm)]))
                            Stitch.Add(stitch_str, branchPath)
            # case: both inputs are flat
            elif Pt.BranchCount == 1 and Cmd.BranchCount == 1:
                # subcase: both BranchCount and number of items are identical
                pt_ipb = [len(br) for br in Pt.Branches]
                cmd_ipb = [len(br) for br in Cmd.Branches]
                if pt_ipb == cmd_ipb:
                    Stitch = Grasshopper.DataTree[object]()
                    for i in range(Pt.BranchCount):
                        branchList = Pt.Branch(i)
                        branchPath = Pt.Path(i)
                        for j in range(branchList.Count):
                            pt = list(branchList[j])
                            comm = Cmd.Branch(i)[j]
                            stitch_str = (",".join([str(pt[0]*10),
                                            str(pt[1]*10), str(comm)]))
                            Stitch.Add(stitch_str, branchPath)
                elif pt_ipb != cmd_ipb and cmd_ipb == [1]:
                    Stitch = Grasshopper.DataTree[object]()
                    for i in range(Pt.BranchCount):
                        branchList = Pt.Branch(i)
                        branchPath = Pt.Path(i)
                        for j in range(branchList.Count):
                            pt = list(branchList[j])
                            comm = Cmd.Branch(0)[0]
                            stitch_str = (",".join([str(pt[0]*10),
                                              str(pt[1]*10), str(comm)]))
                            Stitch.Add(stitch_str, branchPath)
        # return outputs if you have them; here I try it for you:
        return Stitch
# ---------- end cs ----------

# ----
# make a stitchblock by coupling
# the stitches with a coloured thread
csb = ConstructStitchblock(Stitch=cs, Thread=ct)  # -> Stitchblock; inputs Stitch: tree, Thread: tree
# ---------- csb: Python ----------
"""Provides a scripting component.
            Inputs:
                Stitch: The x script variable
                Thread: The y script variable
            Output:
                Stitchblock: The a output variable
            Remarks:
                Author: Max Eschenbach
                License: Apache License 2.0
                Version: 191104"""

from __future__ import division
from ghpythonlib.componentbase import executingcomponent as component
import Grasshopper, GhPython
import System
import Rhino
import rhinoscriptsyntax as rs
import pyembroidery

ghenv.Component.Name = "ConstructStitchblock"
ghenv.Component.NickName = "CSB"
ghenv.Component.Category = "pyembroideryGH"
ghenv.Component.SubCategory = "3 Pattern Creation"

__author__ = "Max Eschenbach"
__version__ = "2019.11.04"

class MyComponent(component):

    def RunScript(self, Stitch, Thread):
        # initialize output
        Stitchblock = Grasshopper.DataTree[object]()

        # loop over all branches of the stitch tree
        for i in range(Stitch.BranchCount):
            branchList = Stitch.Branch(i)
            branchPath = Stitch.Path(i)

            # find the corresponding thread
            if Thread.PathExists(branchPath):
                try:
                    tList = list(Thread.Branch(branchPath))
                    thread = tList[0]
                    # ensure that threads are real threads
                    if isinstance(thread, \
                    pyembroidery.EmbThread) != True:
                        raise TypeError("Supplied threads are no valid " + \
                                        "pyembroidery.EmbThread instances! " + \
                                        "Please check your inputs and try " + \
                                        "again.")
                except IndexError:
                    thread = None
            else:
                thread = None

            # convert stitches to a block
            block = []
            for j in range(branchList.Count):
                # convert the stitch
                stitch = branchList[j].split(",")
                stitch = (float(stitch[0]), float(stitch[1]), int(stitch[2]))
                block.append(stitch)

            sBlock = [block, thread]

            # add stitchblocks to output
            Stitchblock.Add(sBlock, branchPath)

        # return outputs if you have them; here I try it for you:
        return Stitchblock
# ---------- end csb ----------
stitchblock = Data(csb)

# ----
# create an empty pattern to fill with stitches
cp = CreatePattern()  # -> PatternOut; inputs N: tree of Int32
# ---------- cp: Python ----------
"""Create one or a collection of empty embroidery patterns as
instances of pyembroidery.EmbPattern
            Inputs:
                N: The number of empty patterns to be created, 1 if left blank
            Output:
                PatternOut: The empty pyembroidery.EmbPattern instance
            Remarks:
                Author: Max Eschenbach
                License: Apache License 2.0
                Version: 191104"""

from __future__ import division
from ghpythonlib.componentbase import executingcomponent as component
import Grasshopper, GhPython
import System
import Rhino
import rhinoscriptsyntax as rs
import pyembroidery

ghenv.Component.Name = "CreatePattern"
ghenv.Component.NickName = "CP"
ghenv.Component.Category = "pyembroideryGH"
ghenv.Component.SubCategory = "3 Pattern Creation"

__author__ = "Max Eschenbach"
__version__ = "2019.11.04"

class MyComponent(component):

    def RunScript(self, N):
        # default for N
        if not N or N == None or N.DataCount == 0:
            N.Add(1)

        # initialize output
        PatternOut = Grasshopper.DataTree[object]()

        # loop through all branches of the tree
        for i in range(N.BranchCount):
            branchList = N.Branch(i)
            branchPath = N.Path(i)

            # loop through all items in the current branch
            for j in range(branchList.Count):
                num_pats = branchList[j]
                # create empty patterns
                for x in range(num_pats):
                    pat = pyembroidery.EmbPattern()
                    PatternOut.Add(pat, branchPath)

        # return outputs if you have them; here I try it for you:
        return PatternOut
# ---------- end cp ----------
panel_2 = Panel(cp)

# ----
# add the stitchblock(s) to the pattern
asb = AddStitchblock(Pattern=cp, Stitchblock=stitchblock)  # -> PatternOut; inputs Stitchblock: tree
# ---------- asb: Python ----------
"""Adds a stitchblock to an embroidery pattern supplied as
pyembroidery.EmbPattern instance
            Inputs:
                Pattern: The pattern to be modified as
                pyembroidery.EmbPattern instance. This works only on a single
                pattern for now!
                Stitch: The stitchblocks to add to the pattern. If a
                tree is supplied, each branch will be treated as one block.
                Thread: The threads for the pattern, corresponding to
                the blocks of stitches. The paths of the block and the thread
                have to correspond, otherwise the thread won't be found.
                If there's more than one thread in the branch, only the first
                thread will be used!
            Output:
                PatternOut: The modified pattern with the stitchblocks added
            Remarks:
                Author: Max Eschenbach
                License: Apache License 2.0
                Version: 191104"""

from __future__ import division
from ghpythonlib.componentbase import executingcomponent as component
import Grasshopper, GhPython
import System
import Rhino
import rhinoscriptsyntax as rs
import pyembroidery

ghenv.Component.Name = "AddStitchblock"
ghenv.Component.NickName = "ASB"
ghenv.Component.Category = "pyembroideryGH"
ghenv.Component.SubCategory = "3 Pattern Creation"

__author__ = "Max Eschenbach"
__version__ = "2019.11.04"

class MyComponent(component):

    def RunScript(self, Pattern, Stitchblock):
        # initialize outputs
        PatternOut = Grasshopper.DataTree[object]()

        # copy the input pattern to avoid modification on the original object
        if isinstance(Pattern, pyembroidery.EmbPattern) == True:
            cPattern = Pattern.copy()
        else:
            raise TypeError("Supplied pattern is no valid " + \
                            "pyembroidery.EmbPattern instance! " + \
                            "Please check your inputs and try again.")

        # loop over all branches of the stitchblock tree
        for i in range(Stitchblock.BranchCount):
            branchList = Stitchblock.Branch(i)
            branchPath = Stitchblock.Path(i)

            # loop over all items in the current branch
            for j in range(branchList.Count):
                sBlock = branchList[j]

                # add stitchblock to the pattern
                cPattern.add_stitchblock(sBlock)

        # add pattern to output tree
        PatternOut.Add(cPattern)

        # return outputs if you have them; here I try it for you:
        return PatternOut
# ---------- end asb ----------

# ----
# save the pattern to a file specified in the
# panel. The filename has to end with ".PES"
# 
# if you press the button and the file path is
# correct, the pattern will be saved in that file.
panel_3 = Panel("C:\Users\EFESTWIN\Desktop\Test.PES")
write_file = Button()
path = FilePath(panel_3)
pw = PatternWrite(Pattern=asb, FilePath=path, Execute=write_file)  # inputs Pattern: tree, Execute: Boolean
# ---------- pw: Python ----------
"""Writes one or many embroidery patterns to one or many files. If multiple
patterns are supplied but only one filepath, only the first pattern will be
written to the file to avoid errors!
            Inputs:
                Pattern: The pattern or many patterns as
                pyembroidery.EmbPattern instance
                FilePath: The Filepath(s) of the file(s) to be written
                Execute: Connect a Boolean Button here, press that button to
                write the files.
            Remarks:
                Author: Max Eschenbach
                License: Apache License 2.0
                Version: 191104"""

from __future__ import division
from ghpythonlib.componentbase import executingcomponent as component
import Grasshopper, GhPython
import System
import Rhino
import rhinoscriptsyntax as rs
import pyembroidery
#import ghpythonlib.treehelpers as th

ghenv.Component.Name = "PatternWrite"
ghenv.Component.NickName = "PW"
ghenv.Component.Category = "pyembroideryGH"
ghenv.Component.SubCategory = "1 Input/Output"

__author__ = "Max Eschenbach"
__version__ = "2019.11.04"

class MyComponent(component):

    def RunScript(self, Pattern, FilePath, Execute):

        if Pattern.DataCount != 0 and Pattern.DataCount < 2:
            pattern = Pattern.Branch(0)
            FilePath = str(FilePath[::]).split("\\")
            FilePath = "\\\\".join(FilePath)


            if Execute == True:
                try:
                    pyembroidery.write(pattern[0], FilePath)
                except IndexError:
                    pass
# ---------- end pw ----------

# ==== cluster WinkelSatinstich
division_count = ClusterInput()
input_crv = ClusterInput()
angle = ClusterInput()
width = ClusterInput()

# ----
# Satinstich mit Neigungswinkel
# input
# output >>>
division_count_2 = Integer(division_count)
input_crv_2 = Curve(input_crv)
angle_2 = Number(angle)
width_2 = Number(width)
division_count_3 = Integer(division_count_2)
input_crv_3 = Curve(input_crv_2)
divide = DivideCurve(Curve=input_crv_3, Count=division_count_3, Kinks=False)  # -> Points, Tangents, Parameters
Z = UnitZ(Factor=1)
num_0_5 = Number(0.5)
width_3 = Number(width_2)
multiplication = Multiplication(A=width_3, B=num_0_5)
xprod = CrossProduct(VectorA=divide.Tangents, VectorB=Z, Unitize=False)  # -> Vector, Length
angle_3 = Number(angle_2)
vrot = Rotate(Vector=xprod.Vector, Axis=Z, Angle=degrees(angle_3))
amp = Amplitude(Vector=vrot, Amplitude=multiplication)
move = Move(Geometry=divide.Points, Motion=expr("x*-1", amp))  # -> Geometry, Transform
move_2 = Move(Geometry=divide.Points, Motion=amp)  # -> Geometry, Transform
shift = ShiftList(List=move.Geometry, Shift=1, Wrap=False)
weave = Weave(Pattern=[0, 1], Stream0=move_2.Geometry, Stream1=shift, NullGaps=False)
stitch_points = Point(simplify(flatten(weave)))
stitch_points_2 = Point(stitch_points)
stitch_points_3 = ClusterOutput(stitch_points_2)

# ==== cluster SatinstichGleichmaessig

# ----
# Satinstich Gleichmäßig
# >>> input
# output >>>
division_count = ClusterInput()
input_crv = ClusterInput()
width = ClusterInput()
division_count_2 = Integer(division_count)
input_crv_2 = Curve(input_crv)
width_2 = Number(width)
division_count_3 = Integer(division_count_2)
input_crv_3 = Curve(input_crv_2)
divide = DivideCurve(Curve=input_crv_3, Count=division_count_3, Kinks=False)  # -> Points, Tangents, Parameters
division_count_4 = Integer(division_count_2)
Z = UnitZ(Factor=1)
num_0_5 = Number(0.5)
width_3 = Number(width_2)
xprod = CrossProduct(VectorA=divide.Tangents, VectorB=Z, Unitize=False)  # -> Vector, Length
multiplication = Multiplication(A=width_3, B=num_0_5)
num_0_5_2 = Number(0.5)
amp = Amplitude(Vector=xprod.Vector, Amplitude=multiplication)
move = Move(Geometry=divide.Points, Motion=amp)  # -> Geometry, Transform

input_crv_4 = Curve(input_crv_2)

len = Length(Curve=input_crv_4)
division = Division(A=len, B=division_count_4)
multiplication_2 = Multiplication(A=division, B=num_0_5_2)
amp_2 = Amplitude(Vector=divide.Tangents, Amplitude=multiplication_2)
addition = Addition(A=amp_2, B=amp)
move_2 = Move(Geometry=divide.Points, Motion=expr("x*-1", addition))  # -> Geometry, Transform
shift = ShiftList(List=move_2.Geometry, Shift=1, Wrap=False)
weave = Weave(Pattern=[0, 1], Stream0=move.Geometry, Stream1=shift, NullGaps=False)
stitch_points = Point(simplify(flatten(weave)))
stitch_points_2 = Point(stitch_points)
stitch_points_3 = ClusterOutput(stitch_points_2)

# ==== cluster VorZurueckStich
division_count = ClusterInput()
input_crv = ClusterInput()

# ----
# 2-Vor, 1-Zurück-Stich
# >>> input
# output >>>
division_count_2 = Integer(division_count)
input_crv_2 = Curve(input_crv)
division_count_3 = Integer(division_count_2)
input_crv_3 = Curve(input_crv_2)
divide = DivideCurve(Curve=input_crv_3, Count=division_count_3, Kinks=False)  # -> Points, Tangents, Parameters
shift = ShiftList(List=divide.Points, Shift=2, Wrap=False)
shift_2 = ShiftList(List=divide.Points, Shift=1, Wrap=False)
panel = Panel("""0
2
1""")
weave = Weave(Pattern=panel, Stream0=divide.Points, Stream1=shift_2, Stream2=shift, NullGaps=False)
culln = CullNth(List=weave, CullFrequency=3)
stitch_points = Point(simplify(flatten(culln)))
stitch_points_2 = Point(stitch_points)
stitch_points_3 = ClusterOutput(stitch_points_2)

# ==== cluster Geradstich
division_count = ClusterInput()
multiplicator = ClusterInput()
input_crv = ClusterInput()

# ----
# (Multi-) Geradstich
# >>> input
# output >>>
division_count_2 = Integer(division_count)
multiplicator_2 = Integer(multiplicator)
input_crv_2 = Curve(input_crv)
division_count_3 = Integer(division_count_2)
input_crv_3 = Curve(input_crv_2)
multiplicator_3 = Integer(multiplicator_2)
divide = DivideCurve(Curve=input_crv_3, Count=division_count_3, Kinks=False)  # -> Points, Tangents, Parameters
shift = ShiftList(List=divide.Points, Shift=1, Wrap=False)
dup = DuplicateData(Data=graft(divide.Points), Number=multiplicator_3, Order=True)  # -> flatten(Data)
dup_2 = DuplicateData(Data=graft(shift), Number=multiplicator_3, Order=True)  # -> flatten(Data)
weave = Weave(Pattern=[0, 1], Stream0=dup, Stream1=dup_2, NullGaps=False)
multiplicator_4 = Integer(multiplicator_2)
culln = CullNth(List=weave, CullFrequency=expr("x*2", multiplicator_4))
multiplicator_5 = Integer(expr("x-1", multiplicator_2))
lng = ListLength(List=culln)
subtraction = Subtraction(A=lng, B=multiplicator_5)
split = SplitList(List=culln, Index=subtraction)  # -> ListA, ListB
stitch_points = Point(simplify(flatten(split.ListA)))
stitch_points_2 = Point(stitch_points)
stitch_points_3 = ClusterOutput(stitch_points_2)

# ==== cluster Satinstich
resolution = ClusterInput()

# ----
# input
input_crv = ClusterInput()
width = ClusterInput()
resolution_2 = Integer(resolution)
input_crv_2 = Curve(input_crv)
width_2 = Number(width)

# ----
# Satinstich Einfach
resolution_3 = Integer(resolution_2)
input_crv_3 = Curve(input_crv_2)
divide = DivideCurve(Curve=input_crv_3, Count=resolution_3, Kinks=False)  # -> Points, Tangents, Parameters
Z = UnitZ(Factor=1)
num_0_5 = Number(0.5)
width_3 = Number(width_2)
xprod = CrossProduct(VectorA=divide.Tangents, VectorB=Z, Unitize=False)  # -> Vector, Length
multiplication = Multiplication(A=width_3, B=num_0_5)
amp = Amplitude(Vector=xprod.Vector, Amplitude=multiplication)
move = Move(Geometry=divide.Points, Motion=expr("x*-1", amp))  # -> Geometry, Transform
move_2 = Move(Geometry=divide.Points, Motion=amp)  # -> Geometry, Transform
shift = ShiftList(List=move.Geometry, Shift=1, Wrap=False)
weave = Weave(Pattern=[0, 1], Stream0=move_2.Geometry, Stream1=shift, NullGaps=False)
stitch_points = Point(simplify(flatten(weave)))
stitch_points_2 = ClusterOutput(stitch_points)
