# Grasshopper definition 201103_pyembroideryGH_Example_01.gh (Grasshopper 1.0.7)
# Copyright: 2018
# Copyright: 2020
# Copyright: 2019

# ----
# Geometry Pipeline "holt" sich die
# Geometrie aus Rhino
# 
# Geometry Pipelines interactively get the
# geometry drawn in Rhino
embroidery_curves_b = GeometryPipeline(
    GroupByLayer=False,
    GroupByType=False,
    IncludeHidden=True,
    IncludeLocked=True,
    LayerFilter="ref___EmbroideryCurves_B",
    NameFilter="*",
    SublayerFiltering=True,
    TypeFilter=4)
embroidery_curves_a = GeometryPipeline(
    GroupByLayer=False,
    GroupByType=False,
    IncludeHidden=True,
    IncludeLocked=True,
    LayerFilter="ref___EmbroideryCurves_A",
    NameFilter="*",
    SublayerFiltering=True,
    TypeFilter=4)
pipeline__embroiderycurves_a = Curve(embroidery_curves_a)
pipeline__embroiderycurves_b = Curve(embroidery_curves_b)

# ----
# Andere Sticharten
# zum ausprobieren
# 
# Different stitch types
# to try out
straight = Straight()
forthback = ForthBack()
# EMBROIDERY COMMANDS (CHEAT SHEET): NO_COMMAND = -1
# STITCH = 0
# JUMP = 1
# TRIM = 2
# STOP = 3
# END = 4
# COLOR_CHANGE = 5
# NEEDLE_SET = 9
# SEQUIN_MODE = 6
# SEQUIN_EJECT = 7
# 
# SLOW = 11
# FAST = 12
# 
# SET_CHANGE_SEQUENCE = 16
# 
# SEW_TO = 176
# NEEDLE_AT = 177
# 
# STITCH_BREAK = 224
# 
# SEQUENCE_BREAK = 225
# COLOR_BREAK = 226
satinsimple = SatinSimple()

# ----
# Hier wird die Kurve referenziert oder eingespeist,
# die in Stiche umgewandelt werden soll >>>
# Die Resolution (Auflösung) legt fest, wie
# oft die Kurve geteilt wird (Feinheitsgrad) >>>
# Mit Width (Breite) wird bei
# Satinstichen die Breite angegeben >>>
# Hier kann die Farbe des Fadens für
# das Stickmuster (Pattern) festgelegt werden >>>
stitchresolution = Slider(600, range=0..2000)
stitchwidth = Slider(1, range=0..10)
pipeline__embroiderycurves = Curve(pipeline__embroiderycurves_a)
colour = ColourPicker(PickedColour=RGB(0, 170, 255))
threadcolor = Colour(colour)
# Stichpunkte aus Kurve(n) erstellen
# 
# Create stitch points based on input curve(s)
satinequal = SatinEqual(curve=pipeline__embroiderycurves, resolution=stitchresolution, width=stitchwidth)
stitchpts = Point(satinequal)

# ----
# Hier wird die Kurve referenziert oder eingespeist,
# die in Stiche umgewandelt werden soll >>>
# Stichpunkte aus Kurve(n) erstellen
# 
# Create stitch points based on input curve(s)
# Die Resolution (Auflösung) legt fest, wie
# oft die Kurve geteilt wird (Feinheitsgrad) >>>
# Mit Width (Breite) wird bei
# Satinstichen die Breite angegeben >>>
# Bei diesem Satinstich kann zusätzlich der
# Winkel (Angle) eingestellt werden >>>
# Hier kann die Farbe des Fadens für
# das Stickmuster (Pattern) festgelegt werden >>>
stitchresolution_2 = Slider(600, range=0..2000)
angle = Slider(-46.8, range=-90..90)
stitchwidth_2 = Slider(3, range=0..10)
pipeline__embroiderycurves_b_2 = Curve(pipeline__embroiderycurves_b)
colour_2 = ColourPicker(PickedColour=RGB(255, 0, 0))
satinangle = SatinAngle(curve=pipeline__embroiderycurves_b_2, resolution=stitchresolution_2, width=stitchwidth_2, angle=angle)
threadcolor_2 = Colour(colour_2)
stitchpts_2 = Point(satinangle)

# ----
# Visualisierung der Stickerei
# in der Farbe des Fadens
# 
# visualisation of the embroidery
# using the thread color
threadcolor_3 = Colour(threadcolor_2)
stitchpts_3 = Point(stitchpts_2)
pline = PolyLine(Vertices=stitchpts_3, Closed=False)
preview = CustomPreview(Geometry=pline, Material=threadcolor_3)

# ----
# Konvertieren der Punkte in Stiche (Stitches)
# 
# Convert Points to stitches
panel = Panel("STITCH")
stc = StringToCommand(CmdStr=panel)  # -> Cmd; inputs CmdStr: tree
# ---------- stc: Python ----------
"""
Converts any valid embroidery command from string into
its integer representation.
    Inputs:
        CmdStr: The embroidery command as string.
                {tree, str}
    Output:
        Cmd: The converted embroidery command as integer if the input string
             is valid, otherwise Null.
             {tree, int}
    Remarks:
        Author: Max Eschenbach
        License: MIT License
        Version: 201030
"""

# PYTHON STANDARD LIBRARY IMPORTS
from __future__ import division

# GHPYTHON SDK IMPORTS
from ghpythonlib.componentbase import executingcomponent as component
import Grasshopper, GhPython
import System
import Rhino
import rhinoscriptsyntax as rs

# GHENV COMPONENT SETTINGS 
ghenv.Component.Name = "StringToCommand"
ghenv.Component.NickName = "STC"
ghenv.Component.Category = "pyembroideryGH"
ghenv.Component.SubCategory = "0 Commands"

# LOCAL MODULE IMPORTS
try:
    import pyembroidery
except ImportError:
    errMsg = ("The pyembroidery python module seems to be not correctly " +
              "installed! Please make sure the module is in you search " +
              "path, see README for instructions!.")
    raise ImportError(errMsg)

class StringToCommand(component):

    def RunScript(self, CmdStrTree):
        # initialize output as GH tree
        Cmd = Grasshopper.DataTree[object]()
        
        # retrieve command dictionary for translation
        command_dict = pyembroidery.get_command_dictionary()
        
        # only do sth if there is valid input to begin with
        if CmdStrTree != None and CmdStrTree.DataCount:
            # loop through all branches of the tree
            for i, branch in enumerate(CmdStrTree.Branches):
                branch_path = CmdStrTree.Path(i)
                # loop through all items in the current branch
                for j, command in enumerate(branch):
                    # look up the command in the dict and add the result to
                    # the output tree
                    try:
                        Cmd.Add(command_dict[command], branch_path)
                    except KeyError:
                        rml = self.RuntimeMessageLevel.Warning
                        errMsg = ("Command '{}' at branch {}, index {} " +
                                  "is not a known embroidery command string!" +
                                  " A Null item will be inserted into the " +
                                  "output tree!")
                        errMsg = errMsg.format(command, i, j)
                        self.AddRuntimeMessage(rml, errMsg)
                        Cmd.Add(None, branch_path)
        else:
            rml = self.RuntimeMessageLevel.Warning
            errMsg = "Input CmdStr failed to collect data!"
            self.AddRuntimeMessage(rml, errMsg)
        
        # return outputs if you have them; here I try it for you:
        return Cmd
# ---------- end stc ----------
stitchpts_4 = Point(stitchpts)
cs = ConstructStitch(Pt=stitchpts_4, Cmd=stc)  # -> Stitch; inputs Pt: list of Point3d, Cmd: list of Int32
# ---------- cs: Python ----------
"""
Constructs a Stitch-String in the format (PtX, PtY, Cmd) by pairing each input
coordinate with an input command.
    Inputs:
        Pt: The input coordinate (point) for the stitch.
            {list, point3d}
        Cmd: The corresponding command integer for each point coordinate.
             {list, int}
    Output:
        Stitch: The constructed stitch as String.
                {item/list/tree, str}
    Remarks:
        Author: Max Eschenbach
        License: MIT License
        Version: 201022
"""

# PYTHON STANDARD LIBRARY IMPORTS
from __future__ import division

# GHPYTHON SDK IMPORTS
from ghpythonlib.componentbase import executingcomponent as component
import Grasshopper, GhPython
import System
import Rhino
import rhinoscriptsyntax as rs

# GHENV COMPONENT SETTINGS
ghenv.Component.Name = "ConstructStitch"
ghenv.Component.NickName = "CS"
ghenv.Component.Category = "pyembroideryGH"
ghenv.Component.SubCategory = "3 Pattern Creation"

class ConstructStitch(component):

    def RunScript(self, Pt, Cmd):
        # initialize ouputs
        Stitches = []
        
        # only act if there is some data to begin with
        if Pt and Cmd:
            # list of points is longer or equal to list of commands, so we
            # loop over the list of points
            if len(Pt) >= len(Cmd):
                for i, pt in enumerate(Pt):
                    # extract command with failsafe
                    if i <= len(Cmd) - 1:
                        command = Cmd[i]
                    else:
                        command = Cmd[-1]
                    # compile stitch string
                    stitch_str = ",".join([str(pt.X * 10), 
                                           str(pt.Y * -10),
                                           str(command)])
                    # append to list of stitches
                    Stitches.append(stitch_str)
            # list of commands is longer than list of points, so we have to
            # loop over the list of commands
            elif len(Pt) < len(Cmd):
                for j, command in enumerate(Cmd):
                    # extract coordinate with failsafe
                    if j <= len(Pt) - 1:
                        pt = Pt[j]
                    else:
                        pt = Pt[-1]
                    # compile stitch string
                    stitch_str = ",".join([str(pt.X * 10),
                                           str(pt.Y * -10),
                                           str(command)])
                    # append to list of stitches
                    Stitches.append(stitch_str)
        else:
            rml = self.RuntimeMessageLevel.Warning
            if not Pt:
                errMsg = "Input Pt failed to collect data!"
                self.AddRuntimeMessage(rml, errMsg)
            if not Cmd:
                errMsg = "Input Cmd failed to collect data!"
                self.AddRuntimeMessage(rml, errMsg)
            return Grasshopper.DataTree[object]()
        
        # return outputs if you have them; here I try it for you:
        return Stitches
# ---------- end cs ----------

# ----
# Einen Faden (Thread) in der festgelegten Farbe erstellen
# 
# Create a thread in the specified color
threadcolor_4 = Colour(threadcolor)
ct = ConstructThread(ColorRGB=threadcolor_4)  # -> Thread; inputs ColorRGB: Color
# ---------- ct: Python ----------
"""
Constructs an embroidery thread from its component parts. The thread is
returned as an instance of pyembroidery.EmbThread.
    Inputs:
        ColorRGB: The color of the thread as RGB color (required).
                  {item, System.Drawing.Color}
        Description: The color description of the thread (optional).
                     {item, str}
        CatalogNr: The catalogue number of the thread (optional).
                   {item, str}
        Details: The details of the thread (optional).
                 {item, str}
        Brand: The brand of the thread (optional).
               {item, str}
        Chart: The chart of the thread (optional).
               {item, str}
        Weight: The weight of the thread (optional).
                {item, str}
    Output:
        Thread: The newly constructed thread for a stitch/pattern as
                pyembroidery.EmbThread instance.
                {item/list/tree, EmbThread}
    Remarks:
        Author: Max Eschenbach
        License: MIT License
        Version: 201022
"""

# PYTHON STANDARD LIBRARY IMPORTS
from __future__ import division

# GHPYTHON SDK IMPORTS
from ghpythonlib.componentbase import executingcomponent as component
import Grasshopper, GhPython
import System
import Rhino
import rhinoscriptsyntax as rs

# ADDITIONAL RHINO AND SYSTEM IMPORTS
import System.Drawing.Color as SysColor

# LOCAL MODULE IMPORTS
try:
    import pyembroidery
except ImportError:
    errMsg = ("The pyembroidery python module seems to be not correctly " +
              "installed! Please make sure the module is in you search " +
              "path, see README for instructions!.")
    raise ImportError(errMsg)

# GHENV COMPONENT SETTINGS
ghenv.Component.Name = "ConstructThread"
ghenv.Component.NickName = "CT"
ghenv.Component.Category = "pyembroideryGH"
ghenv.Component.SubCategory = "3 Pattern Creation"

class ConstructThread(component):

    def RunScript(self, ColorRGB, Description, CatalogNr, Details, Brand, Chart, Weight):
        # initialize output as empty GH datatree
        Thread = Grasshopper.DataTree[object]()
        
        if ColorRGB:
            # create new thread
            Thread = pyembroidery.EmbThread()
            # set the color of the newly created thread
            Thread.set_color(ColorRGB.R, ColorRGB.G, ColorRGB.B)
            # set the other data to the thread if present
            Thread.description = Description
            Thread.catalog_number = CatalogNr
            Thread.details = Details
            Thread.brand = Brand
            Thread.chart = Chart
            Thread.weight = Weight
        else:
            rml = self.RuntimeMessageLevel.Warning
            errMsg = "Input ColorRGB failed to collect data!"
            self.AddRuntimeMessage(rml, errMsg)
        
        # return outputs if you have them; here I try it for you:
        return Thread
# ---------- end ct ----------
panel_2 = Panel(ct)

# ----
# Visualisierung der Stickerei
# in der Farbe des Fadens
# 
# visualisation of the embroidery
# using the thread color
threadcolor_5 = Colour(threadcolor)
stitchpts_5 = Point(stitchpts)
pline_2 = PolyLine(Vertices=stitchpts_5, Closed=False)
preview_2 = CustomPreview(Geometry=pline_2, Material=threadcolor_5)

# ----
# Konvertieren der Punkte in Stiche (Stitches)
# 
# Convert Points to stitches
panel_3 = Panel("STITCH")
stc_2 = StringToCommand(CmdStr=panel_3)  # -> Cmd; inputs CmdStr: tree; same code as stc
stitchpts_6 = Point(stitchpts_2)
cs_2 = ConstructStitch(Pt=stitchpts_6, Cmd=stc_2)  # -> Stitch; inputs Pt: list of Point3d, Cmd: list of Int32; same code as cs

# ----
# Einen Faden (Thread) in der festgelegten Farbe erstellen
# 
# Create a thread in the specified color
threadcolor_6 = Colour(threadcolor_2)
ct_2 = ConstructThread(ColorRGB=threadcolor_6)  # -> Thread; inputs ColorRGB: Color; same code as ct
panel_4 = Panel(ct_2)

# ----
# Erstellen von "StitchBlocks" aus Stichen
# und einem korrespondierenden Faden
# 
# Create "StitchBlocks" from stitches and
# a corresponding thread
csb = ConstructStitchBlock(Stitches=cs, Thread=ct)  # -> StitchBlock; inputs Stitches: list
# ---------- csb: Python ----------
"""
Compile a StitchBlock from a list of stitches and a thread.
    Inputs:
        Stitches: The stitches to compile into a stitchblock.
                  {list, stitch}
        Thread: The thread to be attached to the stitchblock.
                {item, EmbThread}
    Output:
        StitchBlock: The newly compiled stitchblocks, containing the stitches
                     with the respective thread attached to it.
                     {item/list/tree, StitchBlock}
    Remarks:
        Author: Max Eschenbach
        License: MIT License
        Version: 201030
"""

# PYTHON STANDARD LIBRARY IMPORTS
from __future__ import division
import re

# GHPYTHON SDK IMPORTS
from ghpythonlib.componentbase import executingcomponent as component
import Grasshopper, GhPython
import System
import Rhino
import rhinoscriptsyntax as rs

# GHENV COMPONENT SETTINGS
ghenv.Component.Name = "ConstructStitchBlock"
ghenv.Component.NickName = "CSB"
ghenv.Component.Category = "pyembroideryGH"
ghenv.Component.SubCategory = "3 Pattern Creation"

# LOCAL MODULE IMPORTS
try:
    import pyembroidery
except ImportError:
    errMsg = ("The pyembroidery python module seems to be not correctly " +
              "installed! Please make sure the module is in you search " +
              "path, see README for instructions!.")
    raise ImportError(errMsg)

class StitchBlock(object):
    
    def __init__(self, stitches, thread):
        self._set_stitches(stitches)
        self._set_thread(thread)
    
    def __getitem__(self, item):
        return (self.stitches, self.thread)[item]
    
    def get_stitches_iter(self):
        for s in self._stitches:
            yield s
    
    def _get_stitches(self):
        return self._stitches
    
    def _set_stitches(self, stitches):
        if isinstance(stitches, list):
            self._stitches = stitches
        elif isinstance(stitches, tuple):
            self._stitches = list(stitches)
        else:
            raise ValueError("Supplied data for stitches is not a valid list " +
                             "of stitches!")
    
    stitches = property(_get_stitches, _set_stitches, None,
                        "The stitches of this StitchBlock")
    
    def _get_thread(self):
        return self._thread
    
    def _set_thread(self, thread):
        if isinstance(thread, pyembroidery.EmbThread):
            self._thread = thread
        else:
            raise ValueError("Supplied thread is not a valid EmbThread " + 
                             "instance!")
    
    thread = property(_get_thread, _set_thread, None,
                      "The thread of this StitchBlock")
    
    def ToString(self):
        descr = "StitchBlock ({} Stitches, EmbThread {})"
        color = self.thread.hex_color()
        descr = descr.format(len(self.stitches), color)
        return descr

class ConstructStitchBlock(component):
    
    def RunScript(self, Stitches, Thread):
        
        if Stitches and Thread:
            # regex pattern for matching stitch strings
            regex = re.compile(r'^([+-]?(\d+([.]\d*)?([eE][+-]?\d+)?|[.]\d+([eE][+-]?\d+)?)[,]){2}[-+]?[0-9]+$')
            
            # check and extract stitches, compile valid_stitches
            valid_stitches = []
            for i, stitch in enumerate(Stitches):
                if bool(regex.match(stitch)):
                    # convert the stitch
                    stitch = stitch.split(",")
                    stitch = (float(stitch[0]), float(stitch[1]), int(stitch[2]))
                    valid_stitches.append(stitch)
                else:
                    rml = self.RuntimeMessageLevel.Warning
                    errMsg = ("{}. stitch at index {} is not a " +
                              "valid stitch string! Skipping this stitch!")
                    errMsg = errMsg.format(i, self.RunCount)
                    self.AddRuntimeMessage(rml, errMsg)
            
            # create stitchblock
            try:
                sblock = StitchBlock(valid_stitches, Thread)
            except Exception, e:
                rml = self.RuntimeMessageLevel.Warning
                errMsg = "Could not create StitchBlock at index {}!"
                errMsg = " ".join([errMsg, e]).format(self.RunCount)
                self.AddRuntimeMessage(rml, errMsg)
                sblock = None
        else:
            sblock = Grasshopper.DataTree[object]()
            rml = self.RuntimeMessageLevel.Warning
            if not Stitches:
                errMsg = ("Input Stitches failed to collect data!")
                self.AddRuntimeMessage(rml, errMsg)
            if not Thread:
                errMsg = ("Input Thread failed to collect data!")
                self.AddRuntimeMessage(rml, errMsg)
        
        # return outputs if you have them; here I try it for you:
        return sblock
# ---------- end csb ----------
panel_5 = Panel(csb)
stitchblock = Data(csb)

# ----
# Leeres Pattern erstellen
# 
# Create an empty pattern
cp = CreatePattern()  # -> Pattern; inputs N: Int32
# ---------- cp: Python ----------
"""
Create one or a collection of empty embroidery patterns as
instances of pyembroidery.EmbPattern.
    Inputs:
        N: The number of empty patterns to be created, 1 if left blank.
           {item, int}
    Output:
        Pattern: The empty pattern as a pyembroidery.EmbPattern instance.
                 {item/list/tree, EmbPattern}
    Remarks:
        Author: Max Eschenbach
        License: MIT License
        Version: 201022
"""

# PYTHON STANDARD LIBRARY IMPORTS
from __future__ import division

# GHPYTHON SDK IMPORTS
from ghpythonlib.componentbase import executingcomponent as component
import Grasshopper, GhPython
import System
import Rhino
import rhinoscriptsyntax as rs

# GHENV COMPONENT SETTINGS
ghenv.Component.Name = "CreatePattern"
ghenv.Component.NickName = "CP"
ghenv.Component.Category = "pyembroideryGH"
ghenv.Component.SubCategory = "3 Pattern Creation"

# LOCAL MODULE IMPORTS
try:
    import pyembroidery
except ImportError:
    errMsg = ("The pyembroidery python module seems to be not correctly " +
              "installed! Please make sure the module is in you search " +
              "path, see README for instructions!.")
    raise ImportError(errMsg)

class CreatePattern(component):

    def RunScript(self, N):
        # default for N
        if N is None:
            N = 1
        
        # initialize output
        Pattern = System.Collections.Generic.List[object]()
        
        # create empty patterns
        for i in range(N):
            pat = pyembroidery.EmbPattern()
            Pattern.Add(pat)
        
        # return outputs if you have them; here I try it for you:
        return Pattern
# ---------- end cp ----------
panel_6 = Panel(cp)

# ----
# Erstellen von "StitchBlocks" aus Stichen
# und einem korrespondierenden Faden
# 
# Create "StitchBlocks" from stitches and
# a corresponding thread
csb_2 = ConstructStitchBlock(Stitches=cs_2, Thread=ct_2)  # -> StitchBlock; inputs Stitches: list; same code as csb
panel_7 = Panel(csb_2)
stitchblock_2 = Data(csb_2)

# ----
# Leeres Pattern erstellen
# 
# Create an empty pattern
cp_2 = CreatePattern()  # -> Pattern; inputs N: Int32; same code as cp
panel_8 = Panel(cp_2)

# ----
# Die vorher erstellten "StitchBlocks"
# zum Pattern hinzufügen
# 
# Add the previously created "StitchBlocks"
# to the pattern
asb = AddStitchBlock(Pattern=cp, StitchBlock=stitchblock)  # -> Pattern; inputs StitchBlock: list
# ---------- asb: Python ----------
"""
Adds one or many StitchBlocks to an embroidery pattern supplied as
pyembroidery.EmbPattern instance
    Inputs:
        Pattern: The pattern to be modified as pyembroidery.EmbPattern 
                 instance.
                 {item, EmbPattern}
        StitchBlock: The stitchblock(s) to add to the pattern.
                     {list, StitchBlock}
    Output:
        Pattern: The modified pattern with the newly added stitchblock(s).
                 {item/list/tree, EmbPattern}
    Remarks:
        Author: Max Eschenbach
        License: MIT License
        Version: 201030
"""

# PYTHON STANDARD LIBRARY IMPORTS
from __future__ import division

# GHPYTHON SDK IMPORTS
from ghpythonlib.componentbase import executingcomponent as component
import Grasshopper, GhPython
import System
import Rhino
import rhinoscriptsyntax as rs

# GHENV COMPONENT SETTINGS
ghenv.Component.Name = "AddStitchBlock"
ghenv.Component.NickName = "ASB"
ghenv.Component.Category = "pyembroideryGH"
ghenv.Component.SubCategory = "3 Pattern Creation"

# LOCAL MODULE IMPORTS
try:
    import pyembroidery
except ImportError:
    errMsg = ("The pyembroidery python module seems to be not correctly " +
              "installed! Please make sure the module is in you search " +
              "path, see README for instructions!.")
    raise ImportError(errMsg)

class StitchBlock(object):
    
    def __init__(self, stitches, thread):
        self._set_stitches(stitches)
        self._set_thread(thread)
    
    def __getitem__(self, item):
        return (self.stitches, self.thread)[item]
    
    def get_stitches_iter(self):
        for s in self._stitches:
            yield s
    
    def _get_stitches(self):
        return self._stitches
    
    def _set_stitches(self, stitches):
        if isinstance(stitches, list):
            self._stitches = stitches
        elif isinstance(stitches, tuple):
            self._stitches = list(stitches)
        else:
            raise ValueError("Supplied data for stitches is not a valid list " +
                             "of stitches!")
    
    stitches = property(_get_stitches, _set_stitches, None,
                        "The stitches of this StitchBlock")
    
    def _get_thread(self):
        return self._thread
    
    def _set_thread(self, thread):
        if isinstance(thread, pyembroidery.EmbThread):
            self._thread = thread
        else:
            raise ValueError("Supplied thread is not a valid EmbThread " + 
                             "instance!")
    
    thread = property(_get_thread, _set_thread, None,
                      "The thread of this StitchBlock")
    
    def ToString(self):
        descr = "StitchBlock ({} Stitches, EmbThread {})"
        color = self.thread.hex_color()
        descr = descr.format(len(self.stitches), color)
        return descr

class AddStitchBlock(component):

    def RunScript(self, pattern_in, stitchblock):
        # initialize outputs
        Pattern = Grasshopper.DataTree[object]()
        
        if pattern_in is not None and stitchblock:
            # copy the input pattern to avoid modification on the original object
            if isinstance(pattern_in, pyembroidery.EmbPattern):
                pattern_in = pattern_in.copy()
            else:
                raise TypeError("Supplied pattern is no valid " +
                                "pyembroidery.EmbPattern instance! " +
                                "Please check your inputs and try again.")
            
            # loop over all stitchblocks and add to pattern
            for i, sb in enumerate(stitchblock):
                pattern_in.add_stitchblock(sb)
            
            # add pattern to output tree
            Pattern.Add(pattern_in)
        else:
            rml = self.RuntimeMessageLevel.Warning
            if pattern_in is None:
                errMsg = ("Input Pattern failed to collect data!")
                self.AddRuntimeMessage(rml, errMsg)
            if not stitchblock:
                errMsg = ("Input StitchBlock failed to collect data!")
                self.AddRuntimeMessage(rml, errMsg)
        
        # return outputs if you have them; here I try it for you:
        return Pattern
# ---------- end asb ----------
panel_9 = Panel(asb)

# ----
# Die vorher erstellten "StitchBlocks"
# zum Pattern hinzufügen
# 
# Add the previously created "StitchBlocks"
# to the pattern
asb_2 = AddStitchBlock(Pattern=cp_2, StitchBlock=stitchblock_2)  # -> Pattern; inputs StitchBlock: list; same code as asb
panel_10 = Panel(asb_2)

# ----
# Zusammenfügen mehrerer Patterns
# in ein ein Pattern
# 
# Merge multiple patterns into
# a single pattern
mp = MergePattern(Patterns=[asb, asb_2])  # -> Pattern; inputs Patterns: list
# ---------- mp: Python ----------
"""
Merges several embroidery patterns into a single pattern.
It accounts for some edge conditions but not all of them.

If there is an end command on the current pattern, that is removed.
If the color ending the current pattern is equal to the color starting the
next those color blocks are merged.
Any prepended thread change command to the merging pattern is suppressed.
    Inputs:
        Pattern: The list of patterns to be merged into one pattern.
                 {list, EmbPattern}
    Output:
        Pattern: The merged pattern.
                 {item/list/tree, EmbPattern}
    Remarks:
        Author: Max Eschenbach
        License: MIT License
        Version: 201030
"""

# PYTHON STANDARD LIBRARY IMPORTS
from __future__ import division

# GHPYTHON SDK IMPORTS
from ghpythonlib.componentbase import executingcomponent as component
import Grasshopper, GhPython
import System
import Rhino
import rhinoscriptsyntax as rs

# GHENV COMPONENT SETTINGS
ghenv.Component.Name = "MergePattern"
ghenv.Component.NickName = "MP"
ghenv.Component.Category = "pyembroideryGH"
ghenv.Component.SubCategory = "4 Utility"

# LOCAL MODULE IMPORTS
try:
    import pyembroidery
except ImportError:
    errMsg = ("The pyembroidery python module seems to be not correctly " +
              "installed! Please make sure the module is in you search " +
              "path, see README for instructions!.")
    raise ImportError(errMsg)

class MergePattern(component):

    def RunScript(self, Patterns):
        # initialize outputs
        MergedPattern = Grasshopper.DataTree[object]()
        
        if Patterns:
            for i, pat in enumerate(Patterns):
                # check input data correctness
                if isinstance(pat, pyembroidery.EmbPattern):
                    # copy first pattern to the merged pattern
                    if i == 0:
                        MergedPattern = pat.copy()
                    else:
                        MergedPattern = MergedPattern + pat
                else:
                    rml = self.RuntimeMessageLevel.Warning
                    errMsg = ("Supplied pattern at branch {0}, index {1} is no "
                              "valid instance of pyembroidery.EmbPattern! It was "
                              "skipped during the merge!")
                    errMsg = errMsg.format(self.RunCount, i)
                    self.AddRuntimeMessage(rml, errMsg)
                    continue
        else:
            rml = self.RuntimeMessageLevel.Warning
            errMsg = ("Input Pattern failed to collect data!")
            self.AddRuntimeMessage(rml, errMsg)
        
        # return outputs if you have them; here I try it for you:
        return MergedPattern
# ---------- end mp ----------
panel_11 = Panel(mp)

# ----
# Einen Speicherort festlegen und
# das Pattern exportieren
# 
# Specify file path and export
# the pattern to disk
write_pattern_to_file = Button()
path = FilePath()
pw = PatternWrite(Pattern=mp, FilePath=path, Execute=write_pattern_to_file)  # inputs Pattern: list, FilePath: list, Execute: Boolean
# ---------- pw: Python ----------
"""
Writes one or many embroidery patterns to one or many files. If multiple
patterns are supplied but only one filepath, additional filepaths in the
same folder with the indices of the pattern as suffix will be created!
---
Supported file formats are:
*.pec, *.pes, *.exp, *.dst, *.jef, *.vp3, *.csv, *.xxx, *.sew, *.u01, *.shv,
*.10o, *.100, *.bro, *.dat, *.dsb, *.dsz, *.emd, *.exy, *.fxy, *.gt, *.inb,
*.tbf, *.ksm, *.tap, *.stx, *.phb, *.phc, *.new, *.max, *.mit, *.pcd, *.pcq,
*.pcm, *.pcs, *.jpx, *.stc, *.zxy, *.pmv, *.png, *.txt, *.gcode, *.hus, *.edr,
*.col, *.inf, *.json
    Inputs:
        Pattern: One or several embroidery patterns as pyembroidery.EmbPattern 
                 instances.
                 {item, EmbPattern}
        FilePath: The Filepath(s) of the file(s) to be written
        Execute: Connect a Boolean Button here, press that button to
        write the files.
    Remarks:
        Author: Max Eschenbach
        License: MIT License
        Version: 201030
"""

# PYTHON STANDARD LIBRARY IMPORTS
from __future__ import division
from os import path

# GHPYTHON SDK IMPORTS
from ghpythonlib.componentbase import executingcomponent as component
import Grasshopper, GhPython
import System
import Rhino
import rhinoscriptsyntax as rs

# ADDITIONAL RHINO IMPORTS
from scriptcontext import sticky as st

# GHENV COMPONENT SETTINGS
ghenv.Component.Name = "PatternWrite"
ghenv.Component.NickName = "PW"
ghenv.Component.Category = "pyembroideryGH"
ghenv.Component.SubCategory = "1 Input/Output"

# LOCAL MODULE IMPORTS
try:
    import pyembroidery
except ImportError:
    errMsg = ("The pyembroidery python module seems to be not correctly " +
              "installed! Please make sure the module is in you search " +
              "path, see README for instructions!.")
    raise ImportError(errMsg)

class PatternWrite(component):
    
    def RunScript(self, Pattern, FilePath, Execute):
        # check supported formats
        supported = [d["extension"] for d in pyembroidery.supported_formats()]
        supported = ["." + ext for ext in supported]
        supported = {ext : True for ext in supported}
        
        # verify pattern and filepaths
        if Pattern and FilePath:
            # make info message
            if len(Pattern) > len(FilePath):
                rml = self.RuntimeMessageLevel.Remark
                imsg = ("List of supplied filepaths does not suffice. " +
                        "Additional filepaths will be constructed based on " +
                        "the last one to write all patterns!")
                self.AddRuntimeMessage(rml, imsg)
            
            # loop over patterns and verify/construct filepaths
            for i, pat in enumerate(Pattern):
                # if there is a valid supplied filepath
                if i <= len(FilePath) -1:
                    # normalize path and get extension
                    fp = path.normpath(FilePath[i].strip("\n\r"))
                    ext = path.splitext(fp)[1]
                    # if format in not supported, add warning
                    if ext not in supported:
                        rml = self.RuntimeMessageLevel.Warning
                        errMsg = ("Format with extension '{}' is not a " + 
                                  "supported file format! Please check the " + 
                                  "description for a list of supported " +
                                  "formats. This pattern will not be written!")
                        errMsg = errMsg.format(ext)
                        self.AddRuntimeMessage(rml, errMsg)
                        continue
                else:
                    fp = path.normpath(FilePath[-1].strip("\n\r"))
                    fp, ext = path.splitext(fp)
                    # if format in not supported, add warning
                    if ext not in supported:
                        rml = self.RuntimeMessageLevel.Warning
                        errMsg = ("Format with extension '{}' is not a " + 
                                  "supported file format! Please check the " + 
                                  "description for a list of supported " +
                                  "formats. This pattern will not be written!")
                        errMsg = errMsg.format(ext)
                        self.AddRuntimeMessage(rml, errMsg)
                        continue
                    # alter filepath to avoid overwriting original files
                    fp = fp + " ({})"
                    fp = fp.format(i - len(FilePath) + 1) + ext
                
                # write on execute
                if Execute:
                    pyembroidery.write(pat, fp)
        else:
            rml = self.RuntimeMessageLevel.Warning
            if not Pattern: 
                errMsg = "Input Pattern failed to collect data!"
                self.AddRuntimeMessage(rml, errMsg)
            if not FilePath:
                errMsg = "Input FilePath failed to collect data!"
                self.AddRuntimeMessage(rml, errMsg)
# ---------- end pw ----------

# ==== cluster SatinAngle: Creates satin stitches with a custom angle based on an input curve.

# ----
# Satinstich mit Neigungswinkel
# input
# output >>>
resolution = ClusterInput()
width = ClusterInput()
curve = ClusterInput()
angle = ClusterInput()
resolution_2 = Integer(resolution)
curve_2 = Curve(curve)
width_2 = Number(width)
angle_2 = Number(angle)
resolution_3 = Integer(resolution_2)
curve_3 = Curve(curve_2)
divide = DivideCurve(Curve=curve_3, Count=resolution_3, Kinks=False)  # -> Points, Tangents, Parameters
Z = UnitZ(Factor=1)
num_0_5 = Number(0.5)
width_3 = Number(width_2)
multiplication = Multiplication(A=width_3, B=num_0_5)
xprod = CrossProduct(VectorA=divide.Tangents, VectorB=Z, Unitize=False)  # -> Vector, Length
angle_3 = Number(angle_2)
vrot = Rotate(Vector=xprod.Vector, Axis=Z, Angle=degrees(angle_3))
amp = Amplitude(Vector=vrot, Amplitude=multiplication)
move = Move(Geometry=divide.Points, Motion=expr("x*-1", amp))  # -> Geometry, Transform
move_2 = Move(Geometry=divide.Points, Motion=amp)  # -> Geometry, Transform
curve_4 = Curve(curve_2)
item = ListItem(List=move.Geometry, Index=0, Wrap=True)
shift = ShiftList(List=move.Geometry, Shift=1, Wrap=False)
cls = Closed(Curve=curve_4)  # -> Closed, Periodic
pshift = ShiftPaths(Data=shift, Offset="-1")
merge = Merge(Data1=item, Data2=pshift)
weave = Weave(Pattern=[0, 1], Stream0=move_2.Geometry, Stream1=merge, NullGaps=False)
dispatch = Dispatch(List=weave, DispatchPattern=graft(cls.Closed))  # -> ListA, ListB
clean = CleanTree(RemoveNulls=True, RemoveInvalid=True, RemoveEmpty=True, Tree=dispatch.ListB)
clean_2 = CleanTree(RemoveNulls=True, RemoveInvalid=True, RemoveEmpty=True, Tree=dispatch.ListA)
item_2 = ListItem(List=clean_2, Index=0, Wrap=True)
merge_2 = Merge(Data1=clean_2, Data2=item_2)
merge_3 = Merge(Data1=merge_2, Data2=clean)
stitchpts = Point(merge_3)
stitchpts_2 = Point(stitchpts)
stitchpts_3 = ClusterOutput(stitchpts_2)

pline = PolyLine(Vertices=stitchpts, Closed=False)

# ==== cluster ForthBack: Creates stitches that travel 2 units forth and 1 unit back along an input curve.

# ----
# 2-Vor, 1-Zurück-Stich
# >>> input
# output >>>
resolution = ClusterInput()
curve = ClusterInput()
resolution_2 = Integer(resolution)
curve_2 = Curve(curve)
resolution_3 = Integer(resolution_2)
curve_3 = Curve(curve_2)
divide = DivideCurve(Curve=curve_3, Count=resolution_3, Kinks=False)  # -> Points, Tangents, Parameters
shift = ShiftList(List=divide.Points, Shift=2, Wrap=False)
shift_2 = ShiftList(List=divide.Points, Shift=1, Wrap=False)
panel = Panel("""0
2
1""")
weave = Weave(Pattern=panel, Stream0=divide.Points, Stream1=shift_2, Stream2=shift, NullGaps=False)
culln = CullNth(List=weave, CullFrequency=3)
pshift = ShiftPaths(Data=culln, Offset="-1")
stitchpts = Point(pshift)
stitchpts_2 = Point(stitchpts)
stitchpts_3 = ClusterOutput(stitchpts_2)

pline = PolyLine(Vertices=stitchpts, Closed=False)  # disabled

# ==== cluster Straight

# ----
# (Multi-) Geradstich
# >>> input
# output >>>
resolution = ClusterInput()
multiplicator = ClusterInput()
curve = ClusterInput()
multiplicator_2 = Integer(multiplicator)
resolution_2 = Integer(resolution)
curve_2 = Curve(curve)
resolution_3 = Integer(resolution_2)
curve_3 = Curve(curve_2)
multiplicator_3 = Integer(multiplicator_2)
divide = DivideCurve(Curve=curve_3, Count=resolution_3, Kinks=False)  # -> Points, Tangents, Parameters
shift = ShiftList(List=divide.Points, Shift=1, Wrap=False)
dup = DuplicateData(Data=graft(shift), Number=multiplicator_3, Order=True)
dup_2 = DuplicateData(Data=graft(divide.Points), Number=multiplicator_3, Order=True)
pshift = ShiftPaths(Data=dup_2, Offset="-2")
pshift_2 = ShiftPaths(Data=dup, Offset="-2")
weave = Weave(Pattern=[0, 1], Stream0=pshift, Stream1=pshift_2, NullGaps=False)
multiplicator_4 = Integer(multiplicator_2)
culln = CullNth(List=weave, CullFrequency=expr("x*2", multiplicator_4))
multiplicator_5 = Integer(expr("x-1", multiplicator_2))
lng = ListLength(List=culln)
subtraction = Subtraction(A=lng, B=multiplicator_5)
split = SplitList(List=culln, Index=subtraction)  # -> ListA, ListB
pshift_3 = ShiftPaths(Data=split.ListA, Offset="-2")
stitchpts = Point(pshift_3)
stitchpts_2 = Point(stitchpts)
stitchpts_3 = ClusterOutput(stitchpts_2)

pline = PolyLine(Vertices=stitchpts, Closed=False)  # disabled

# ==== cluster SatinSimple: Creates simple satin stitches based on an input curve.
resolution = ClusterInput()

# ----
# input
curve = ClusterInput()
width = ClusterInput()
resolution_2 = Integer(resolution)
width_2 = Number(width)
curve_2 = Curve(curve)

# ----
# Satinstich Einfach
resolution_3 = Integer(resolution_2)
curve_3 = Curve(curve_2)
divide = DivideCurve(Curve=curve_3, Count=resolution_3, Kinks=False)  # -> Points, Tangents, Parameters
Z = UnitZ(Factor=1)
num_0_5 = Number(0.5)
width_3 = Number(width_2)
xprod = CrossProduct(VectorA=divide.Tangents, VectorB=Z, Unitize=False)  # -> Vector, Length
multiplication = Multiplication(A=width_3, B=num_0_5)
amp = Amplitude(Vector=xprod.Vector, Amplitude=multiplication)
move = Move(Geometry=divide.Points, Motion=expr("x*-1", amp))  # -> Geometry, Transform
move_2 = Move(Geometry=divide.Points, Motion=amp)  # -> Geometry, Transform
item = ListItem(List=move.Geometry, Index=0, Wrap=True)
shift = ShiftList(List=move.Geometry, Shift=1, Wrap=False)
pshift = ShiftPaths(Data=shift, Offset="-1")
curve_4 = Curve(curve_2)
merge = Merge(Data1=item, Data2=pshift)
cls = Closed(Curve=curve_4)  # -> Closed, Periodic
weave = Weave(Pattern=[0, 1], Stream0=move_2.Geometry, Stream1=merge, NullGaps=False)
dispatch = Dispatch(List=weave, DispatchPattern=graft(cls.Closed))  # -> ListA, ListB
clean = CleanTree(RemoveNulls=False, RemoveInvalid=False, RemoveEmpty=True, Tree=dispatch.ListA)
clean_2 = CleanTree(RemoveNulls=False, RemoveInvalid=False, RemoveEmpty=True, Tree=dispatch.ListB)
item_2 = ListItem(List=clean, Index=0, Wrap=True)
merge_2 = Merge(Data1=clean, Data2=item_2)
merge_3 = Merge(Data1=merge_2, Data2=clean_2)
stitchpts = Point(merge_3)
stitchpts_2 = ClusterOutput(stitchpts)

pline = PolyLine(Vertices=merge_3, Closed=False)  # disabled

# ==== cluster SatinEqual: Creates equalized satin stitches based on an input curve.

# ----
# Satinstich Gleichmäßig
# >>> input
# output >>>
resolution = ClusterInput()
curve = ClusterInput()
width = ClusterInput()
resolution_2 = Integer(resolution)
curve_2 = Curve(curve)
width_2 = Number(width)
resolution_3 = Integer(resolution_2)
curve_3 = Curve(curve_2)
curve_4 = Curve(curve_2)
divide = DivideCurve(Curve=curve_3, Count=resolution_3, Kinks=False)  # -> Points, Tangents, Parameters
Z = UnitZ(Factor=1)
resolution_4 = Integer(resolution_2)
num_0_5 = Number(0.5)
len = Length(Curve=curve_4)
width_3 = Number(width_2)
xprod = CrossProduct(VectorA=divide.Tangents, VectorB=Z, Unitize=False)  # -> Vector, Length
division = Division(A=len, B=resolution_4)
multiplication = Multiplication(A=width_3, B=num_0_5)
num_0_5_2 = Number(0.5)
multiplication_2 = Multiplication(A=division, B=num_0_5_2)
amp = Amplitude(Vector=divide.Tangents, Amplitude=multiplication_2)
amp_2 = Amplitude(Vector=xprod.Vector, Amplitude=multiplication)
addition = Addition(A=amp, B=amp_2)
curve_5 = Curve(curve_2)
cls = Closed(Curve=curve_5)  # -> Closed, Periodic
move = Move(Geometry=divide.Points, Motion=expr("x*-1", addition))  # -> Geometry, Transform
move_2 = Move(Geometry=divide.Points, Motion=amp_2)  # -> Geometry, Transform
shift = ShiftList(List=move.Geometry, Shift=1, Wrap=graft(cls.Closed))
panel = Panel("""0
1""")
weave = Weave(Pattern=panel, Stream0=move_2.Geometry, Stream1=shift, NullGaps=False)
dispatch = Dispatch(List=weave, DispatchPattern=graft(cls.Closed))  # -> ListA, ListB
clean = CleanTree(RemoveNulls=True, RemoveInvalid=True, RemoveEmpty=True, Tree=dispatch.ListB)
clean_2 = CleanTree(RemoveNulls=True, RemoveInvalid=True, RemoveEmpty=True, Tree=dispatch.ListA)
item = ListItem(List=clean_2, Index=0, Wrap=True)
merge = Merge(Data1=clean_2, Data2=item)
merge_2 = Merge(Data1=merge, Data2=clean)
stitchpts = Point(merge_2)
stitchpts_2 = Point(stitchpts)
stitchpts_3 = ClusterOutput(stitchpts_2)

pline = PolyLine(Vertices=stitchpts, Closed=False)  # disabled
